# Grasshopper definition Portraits 3.gh (Grasshopper 1.0.7)
# plug-ins: Human

path = FilePath("C:\Users\oluwa\OneDrive\Education\IaaC_MaCAD\Projects\Module 02\S3_Digital Tools for Data Management\Homework\Homework-3_Portraits\Images\Test Image_Marilyn.jpg")
serialize_image_to_string = SerializeImageToString(ImagePath=path)
image_file = GetString(serialize_image_to_string, AtLeast=1, AtMost=1)
deserialize_image_from_string = DeserializeImageFromString(ImageString=image_file)
image_resolution = GetNumber(
    Slider(0.5, range=0.25..1),
    AtLeast=1,
    AtMost=1,
    Maximum=1.797693135e+308,
    Minimum=-1.797693135e+308,
    Prompt="Set image resolution as percentage of pixel count")
scale = GetNumber(
    Slider(0.05, range=0.05..1.1),
    AtLeast=1,
    AtMost=1,
    Maximum=1.797693135e+308,
    Minimum=-1.797693135e+308,
    Prompt="Set size as percentage of original image size")
pixels = GetInteger(
    Slider(2, range=0..2),
    AtLeast=1,
    AtMost=1,
    Maximum=2147483647,
    Minimum=-2147483648,
    Prompt="Select Pixelation: 0 = Circles ; 1 = Rectangles;  2 = Curves")
color_mode = GetBoolean(
    Slider(0, range=0..1),
    AtLeast=1,
    AtMost=1,
    FalseValue="False",
    Prompt="Select Colour Mode: 0 = Coloured; 1= Black and White",
    TrueValue="True")
invert_image = GetBoolean(
    Slider(0, range=0..1),
    AtLeast=1,
    AtMost=1,
    FalseValue="False",
    Prompt="Create image negatives: 0 = Standard;  1 = Negative",
    TrueValue="True")
displacement = GetInteger(
    Slider(0, range=0..10),
    AtLeast=1,
    AtMost=1,
    Maximum=2147483647,
    Minimum=-2147483648,
    Prompt="Add displacement for 3D Effect")
distortion = GetInteger(Slider(90, range=0..1000), AtLeast=1, AtMost=1, Maximum=2147483647, Minimum=-2147483648, Prompt="Distortion")
abstraction = GetNumber(
    Slider(0, range=0..1),
    AtLeast=1,
    AtMost=1,
    Maximum=1.797693135e+308,
    Minimum=-1.797693135e+308,
    Prompt="Reduce Image for Abstract Effect. 0 = No Pixel removal; 1 = Removes all Pixels")
img = ImportImage(File=deserialize_image_from_string)
bbox = BoundingBox(Content=img, Plane=PlaneXY(0, 0, 0))  # -> Box, Box_2
dim = Dimensions(Surface=bbox.Box)  # -> UDimension, VDimension
multiplication = Multiplication(A=dim.UDimension, B=scale)
multiplication_2 = Multiplication(A=dim.VDimension, B=scale)
image_height = GetInteger(multiplication_2, AtLeast=1, AtMost=1, Maximum=2147483647, Minimum=-2147483648)
image_width = GetInteger(multiplication, AtLeast=1, AtMost=1, Maximum=2147483647, Minimum=-2147483648)
division = Division(A=image_width, B="2")
division_2 = Division(A=image_height, B="2")
multiplication_3 = Multiplication(A=image_width, B=image_resolution)
multiplication_4 = Multiplication(A=image_height, B=image_resolution)
rep = ReplaceText(Text=" -x to x", Find="x", Replace=division_2, RecursiveReplace=False)
rep_2 = ReplaceText(Text=" -x to x", Find="x", Replace=division, RecursiveReplace=False)
int = Integer(multiplication_3)
int_2 = Integer(multiplication_4)
rectangle = Rectangle(Plane=PlaneXY(0, 0, 0), XSize=rep_2, YSize=rep, Radius=0)  # -> Rectangle, Length
img_2 = ImportImage(File=deserialize_image_from_string, Rectangle=rectangle.Rectangle, XSamples=int, YSamples=int_2)
demesh = DeconstructMesh(Mesh=img_2)  # -> Vertices, Faces, Colours, Normals
ahsl = SplitAHSL(Colour=demesh.Colours)  # -> Alpha, Hue, Saturation, Luminance
pt = Point(demesh.Vertices)
col = Colour(demesh.Colours)

subtraction = Subtraction(A="1", B=ahsl.Luminance)
expression = Expression(x=ahsl.Luminance, y=abstraction, Expression="if((x>y)or (x=y),True,False)")
expression_2 = Expression(x=subtraction, y=abstraction, Expression="if((x>y)or (x=y),True,False)")
cull = CullPattern(List=subtraction, CullPattern=expression_2)
cull_2 = CullPattern(List=col, CullPattern=expression)
cull_3 = CullPattern(List=pt, CullPattern=expression_2)
cull_4 = CullPattern(List=ahsl.Luminance, CullPattern=expression)
cull_5 = CullPattern(List=pt, CullPattern=expression)
cull_6 = CullPattern(List=col, CullPattern=expression_2)
filter = StreamFilter(Gate=invert_image, Stream0=cull, Stream1=cull_4)
filter_2 = StreamFilter(Gate=invert_image, Stream0=cull_3, Stream1=cull_5)
filter_3 = StreamFilter(Gate=invert_image, Stream0=cull_6, Stream1=cull_2)

division_3 = Division(A=image_width, B=multiplication_3)

# ---- group: Colour Stream
filter_4 = StreamFilter(Gate=color_mode, Stream0=filter_3, Stream1=ColourSwatch(SwatchColor=RGB(0, 0, 0)))

# ----
division_4 = Division(A=division_3, B="2")
number_slider = Slider(0.1, range=0..0.1)
jitter = Jitter(List=filter_2, Jitter=1, Seed=2)  # -> Values, Indices
neg = Negative(Value=division_4)
multiplication_5 = Multiplication(A=division, B=".05")
vec2pt = Vector2Pt(PointA=filter_2, PointB=jitter.Values, Unitize=False)  # -> Vector, Length
dom = ConstructDomain(DomainStart=neg, DomainEnd=division_4)
rectangle_2 = Rectangle(Plane=filter_2, XSize=dom, YSize=dom, Radius=0)  # -> Rectangle, Length
cir = Circle(Plane=filter_2, Radius=division_4)
line = LineSDL(Start=filter_2, Direction=vec2pt.Vector, Length=multiplication_5)

divide = DivideCurve(Curve=line, Count="6", Kinks=False)  # -> Points, Tangents, Parameters
pdecon = Deconstruct(Point=divide.Points)  # -> XComponent, YComponent, ZComponent
bnd = Bounds(Numbers=pdecon.YComponent)
range = Range(Domain=distortion, Steps="6")
remap = RemapNumbers(Value=pdecon.YComponent, Source=bnd, Target=Domain(0, 1))  # -> Mapped, Clipped
sin = Sine(Value=degrees(range))
multiplication_6 = Multiplication(A=remap.Mapped, B=sin)
bnd_2 = Bounds(Numbers=multiplication_6)
remap_2 = RemapNumbers(Value=multiplication_6, Source=bnd_2, Target=bnd)  # -> Mapped, Clipped
multiplication_7 = Multiplication(A=filter, B=displacement)
pt_2 = ConstructPoint(XCoordinate=pdecon.XComponent, YCoordinate=remap_2.Mapped, ZCoordinate=pdecon.ZComponent)
intcrv = Interpolate(Vertices=pt_2, Degree=3, Periodic=False, KnotStyle=1)  # -> flatten(Curve), Length, Domain

# ---- group: Pixels Stream
filter_5 = StreamFilter(Gate=pixels, Stream0=cir, Stream1=rectangle_2.Rectangle, Stream2=intcrv.Curve)

# ----
Z = UnitZ(Factor=multiplication_7)
move = Move(Geometry=filter_5, Motion=Z)  # -> Geometry, Transform
max = Maximum(A=filter, B="0.0001")
scale_2 = Scale(Geometry=move.Geometry, Center=filter_2, Factor=max)  # -> Geometry, Transform
c_script = CSharpScript(crv=scale_2.Geometry, color=filter_4)  # -> out, A; inputs crv: Curve, color: Color
# ---------- c_script: C# ----------
    var c = color.R + "," + color.G + "," + color.B;
    crv.SetUserString("color", c);
    A = crv;
# ---------- end c_script ----------
preview = CustomPreview(Geometry=c_script.A, Material=filter_4)
toggle = BooleanToggle(True)
clean = CleanTree(RemoveNulls=toggle, RemoveInvalid=toggle, RemoveEmpty=toggle, Tree=c_script.A)

# ---- group: RH_OUT:Sphere
geo = Geometry(simplify(flatten(clean)))
